# Dynamo graph Projection detail line to face_script.dyn (Dynamo 2.12.0.5650)

# group: Pick Face
python_script = Python()  # IronPython2; unwired: IN[0]
# ---------- python_script.python (35 lines) ----------
import clr

clr.AddReference("RevitAPIUI")
from  Autodesk.Revit.UI import *

clr.AddReference("RevitServices")
import RevitServices
from RevitServices.Persistence import DocumentManager
doc = DocumentManager.Instance.CurrentDBDocument
uidoc=DocumentManager.Instance.CurrentUIApplication.ActiveUIDocument

clr.AddReference("RevitNodes")
import Revit
clr.ImportExtensions(Revit.Elements)
clr.ImportExtensions(Revit.GeometryConversion)

clr.AddReference('RevitAPI')
from Autodesk.Revit.DB import *

surfaces, gpoints = [], []
sel1 = uidoc.Selection
ot1 = Selection.ObjectType.Face
ref_list = sel1.PickObjects(ot1, "Select the faces and press Finish.")
for ref in ref_list:
	el1 = doc.GetElement(ref.ElementId)
	sf0 = el1.GetGeometryObjectFromReference(ref)
	if isinstance(el1, FamilyInstance):
		tf1 = el1.GetTransform().ToCoordinateSystem()
		sf1 = sf0.Convert(ref, tf1)
	else:
		sf1 = sf0.ToProtoType(True)
	for i in sf1: i.Tags.AddTag("RevitFaceReference", ref)
	surfaces.append(sf1)

OUT = surfaces
# ----------------------------------------

flatten = List.Flatten(list=python_script)
byJoinedSurfaces = PolySurface.ByJoinedSurfaces(surfaces=flatten)

# group: Get current selection
python_script_2 = Python()  # IronPython2; unwired: IN[0]
# ---------- python_script_2.python (21 lines) ----------
#Copyright(c) 2016, Dimitar Venkov
# @5devene, dimitar.ven@gmail.com

import clr

clr.AddReference("RevitNodes")
import Revit
clr.ImportExtensions(Revit.Elements)

clr.AddReference("RevitServices")
import RevitServices
from RevitServices.Persistence import DocumentManager
doc = DocumentManager.Instance.CurrentDBDocument
uidoc = DocumentManager.Instance.CurrentUIApplication.ActiveUIDocument

def output1(l1):
	if len(l1) == 1: return l1[0]
	else: return l1

selid = uidoc.Selection.GetElementIds()
OUT = output1([doc.GetElement(id).ToDSType(True) for id in selid])
# ----------------------------------------

getLocation = Element.GetLocation(element=python_script_2)
ZAxis = Vector.ZAxis()
projectInputOnto = Surface.ProjectInputOnto(surface=byJoinedSurfaces, geometryToProject=getLocation, projectionDirection=ZAxis)
byCurve = ModelCurve.ByCurve(curve=projectInputOnto)
string = StringInput("""
import clr
clr.AddReference("RevitAPIUI")
from  Autodesk.Revit.UI import *

clr.AddReference("RevitServices")
import RevitServices
from RevitServices.Persistence import DocumentManager
doc = DocumentManager.Instance.CurrentDBDocument
uidoc=DocumentManager.Instance.CurrentUIApplication.ActiveUIDocument

clr.AddReference("RevitNodes")
import Revit
clr.ImportExtensions(Revit.Elements)

def output1(l1):
	if len(l1) == 1: return l1[0]
	else: return l1

sel1 = uidoc.Selection
obt1 = Selection.ObjectType.Element
msg1 = "Select detail line, press ESC to stop selection"
out1 = []

flag = True
TaskDialog.Show("ARC", msg1)
while flag:
	try:
		el1 = doc.GetElement(sel1.PickObject(obt1, msg1).ElementId)
		out1.append(el1.ToDSType(True))
	except:
		flag = False
		TaskDialog.Show("ARC", "Please select faces")
	

OUT = output1(out1)""")
