# Dynamo graph Model curve from edge_script.dyn (Dynamo 2.12.1.8246)

python_script = Python()  # IronPython2; unwired: IN[0]
# ---------- python_script.python (38 lines) ----------
import clr

clr.AddReference("RevitAPIUI")
from  Autodesk.Revit.UI import *

clr.AddReference("RevitServices")
import RevitServices
from RevitServices.Persistence import DocumentManager
doc = DocumentManager.Instance.CurrentDBDocument
uidoc=DocumentManager.Instance.CurrentUIApplication.ActiveUIDocument

clr.AddReference("RevitNodes")
import Revit
clr.ImportExtensions(Revit.Elements)
clr.ImportExtensions(Revit.GeometryConversion)

clr.AddReference('RevitAPI')
from Autodesk.Revit.DB import *

select = uidoc.Selection
option = Selection.ObjectType.Edge
ref = select.PickObject(option, "Select the Edge")
get_element = doc.GetElement(ref.ElementId)
edge = get_element.GetGeometryObjectFromReference(ref)

if isinstance(get_element, FamilyInstance):
	if get_element.HasModifiedGeometry():
		geo_curve = edge.AsCurve()
		return_edge = geo_curve.ToProtoType(True)
	else:
		transform = get_element.GetTransform().ToCoordinateSystem()	
		return_edge = edge.Convert(ref, transform)
else:
	geo_curve = edge.AsCurve()
	return_edge = geo_curve.ToProtoType(True)


OUT = return_edge
# ----------------------------------------
byCurve = ModelCurve.ByCurve(curve=python_script)
